# Grasshopper definition assignment1-vasehops-mp.gh (Grasshopper 1.0.8)

count = GetNumber(Slider(13, range=0..100), AtLeast=1, AtMost=1, Maximum=1.797693135e+308, Minimum=-1.797693135e+308, TreeAccess=False)
seed = GetNumber(Slider(38, range=0..100), AtLeast=1, AtMost=1, Maximum=1.797693135e+308, Minimum=-1.797693135e+308, TreeAccess=False)
pop2d = Populate2D(Region={Plane=PlaneXY(0, 0, 0), Size=Domain2(u=0..20, v=0..10)}, Count=count, Seed=seed)
cir = Circle(Plane=pop2d, Radius=Slider(1, range=0..10))
height = Slider(3, range=0..10)
dom = ConstructDomain(DomainStart=Slider(3, range=0..10), DomainEnd=Slider(11, range=0..100))
area = Area(Geometry=cir)  # -> Area, Centroid
random = Random(Range=dom, Number=count, Seed=2)
Z = UnitZ(Factor=height)
dom_2 = ConstructDomain(DomainStart=Slider(4, range=0..10), DomainEnd=Slider(41, range=0..100))
arrlinear = LinearArray(Geometry=area.Centroid, Direction=Z, Count=random)  # -> Geometry, Transform
lng = ListLength(List=arrlinear.Geometry)
num = Number(flatten(lng))
d_end_radius = GetNumber(Slider(2, range=0..100), AtLeast=1, AtMost=1, Maximum=1.797693135e+308, Minimum=-1.797693135e+308, TreeAccess=False)
d_start_radius = GetNumber(Slider(1, range=0..10), AtLeast=1, AtMost=1, Maximum=1.797693135e+308, Minimum=-1.797693135e+308, TreeAccess=False)
lng_2 = ListLength(List=num)
dom_3 = ConstructDomain(DomainStart=d_start_radius, DomainEnd=d_end_radius)
random_2 = Random(Range=dom_2, Number=lng_2, Seed=Slider(4, range=0..10))  # -> graft(Random)
random_3 = Random(Range=dom_3, Number=lng, Seed=random_2)
cir_2 = Circle(Plane=arrlinear.Geometry, Radius=random_3)
loft = Loft(Curves=cir_2, Options={Adjust=False, Closed=False, LoftEnds=0, LoftSimp=0, LoftType=0, Rebuild=10, Refit=0.01})
context_bake = ContextBake(Content=loft)
